# Grasshopper definition S3.A01_Rodrigo Aguirre_Wavy-surface.gh (Grasshopper 1.0.8)

x_position_0_1 = GetNumber(Slider(0.414, range=0..1), AtLeast=0, AtMost=1, Maximum=1.797693135e+308, Minimum=-1.797693135e+308, TreeAccess=False)
y_position_0_1 = GetNumber(Slider(0.498, range=0..1), AtLeast=0, AtMost=1, Maximum=1.797693135e+308, Minimum=-1.797693135e+308, TreeAccess=False)
frequency = GetNumber(Slider(8.12, range=0..10), AtLeast=0, AtMost=10, Maximum=1.797693135e+308, Minimum=-1.797693135e+308, TreeAccess=False)
height = GetNumber(Slider(14.127, range=0..30), AtLeast=1, AtMost=1, Maximum=1.797693135e+308, Minimum=-1.797693135e+308, TreeAccess=False)
pt = ConstructPoint(XCoordinate=x_position_0_1, YCoordinate=y_position_0_1, ZCoordinate=0)
planesrf = PlaneSurface(Plane=PlaneXY(0, 0, 0), XSize="100", YSize="100")
evalsrf = EvaluateSurface(Surface=reparameterize(planesrf), Point=pt)  # -> Point, Normal, UDirection, VDirection, Frame
sdivide = DivideSurface(Surface=planesrf, UCount="30", VCount="30")  # -> Points, Normals, Parameters
pull = PullPoint(Point=sdivide.Points, Geometry=evalsrf.Point, ClosestOnly=True)  # -> ClosestPoint, Distance
bnd = Bounds(Numbers=flatten(pull.Distance))
remap = RemapNumbers(Value=pull.Distance, Source=bnd, Target=frequency)  # -> Mapped, Clipped
pi = Pi(Factor=remap.Mapped)
sin = Sine(Value=pi)
bnd_2 = Bounds(Numbers=flatten(sin))
remap_2 = RemapNumbers(Value=sin, Source=bnd_2, Target=height)  # -> Mapped, Clipped
Z = UnitZ(Factor=remap_2.Mapped)
move = Move(Geometry=sdivide.Points, Motion=Z)  # -> Geometry, Transform
srfgrid = SurfaceFromPoints(Points=flatten(move.Geometry), UCount=expr("x+1", "30"), Interpolate=False)
srf = Surface(srfgrid)
context_bake = ContextBake(Surface=srf)
